% Simulink data dictionary Interfaces.sldd

DoorStatus = Simulink.ValueType(DataType="double", be=Simulink.BusElement(Name="a", DataType="double"))
EngineStatus = Simulink.ValueType(DataType="double", be=Simulink.BusElement(Name="a", DataType="double"))
FOBSignal = Simulink.ValueType(DataType="double", be=Simulink.BusElement(Name="a", DataType="double"))

KeyFOBPosition = Simulink.Bus()
  radialDist: double, Unit="m"
  isInsideVehicle: boolean